% Simulink data dictionary REL.sldd

Rat_Sts_E = enum(DefaultValue="Rat_Invalid", StorageType="uint8")
  Rat_Invalid = 0
  Rat_All_Lock = 1
  Rat_Half_Lock = 2
  Rat_Unlock = 3

Mot_Cmd_E = enum(DefaultValue="Stop", StorageType="uint8")
  Stop = 0
  Rls = 1
  Reset = 2

Gear_Posn_E = enum(DefaultValue="Gear_Reserved1", StorageType="uint8")
  Gear_Reserved1 = 0
  Gear_P = 1
  Gear_R = 2
  Gear_N = 3
  Gear_D = 4
  Gear_Reserved2 = 5

HndPos_Sts_E = enum(DefaultValue="Hnd_Fold", StorageType="uint8")
  Hnd_Fold = 0
  Hnd_Unfold = 1
  Hnd_Half_Unfold = 2
  Hnd_Error = 3

Unlock_Req_E = enum(DefaultValue="Unlock_Idle", StorageType="uint8")
  Unlock_Idle = 0
  Unlock_Req = 1
  Unlock_PE = 2

Door_Sts_E = enum(DefaultValue="Door_Lock", StorageType="uint8")
  Door_Lock = 0
  Door_Unlock = 1
  Door_SuperLock = 2
  Door_Unknown = 3

Child_Sts_E = enum(DefaultValue="Child_Unlock", StorageType="uint8")
  Child_Unlock = 0
  Child_Lock = 1
  Child_SuperLock = 2
  Child_Unknown = 3